vi "Burst Building.gvi"   [LabVIEW Communications System Design Software 2.0.1]
inputs:
  "Sync Bits [#16]": i8[]
  "Input bit stream": i8[]
  "error in": error
  "# Guard Symbols": i32 = 128
outputs:
  "Output bit stream": i8[]
  "error out": error
diagram:
  # 1
  # 3
  # 4
  # 1. Guard bits are all ones. (111..1).
  # 2. Sync bits are already existing.
  # 3. Divide guard bits to half. Half ot it will be attached to start of burst and 2nd part to the end.
  # 4. After everything is generated, guard and sync bits are added to the msg. (Guard/2+Sync+MSG bits+Guard bits/2, respectively)
  case ($"error in") {
    frame Error {
      w1 = $"Input bit stream"
      w2 = $"error in"
    }
    frame No Error {
      # Generate Guard
      Initialize Array(element=1, size=$"# Guard Symbols") -> w3
      Array Size(array=w3) -> (size(s)=w4)
      # 2
      Divide(x=w4, y=2) -> w5
      Split 1D Array(array=w3, index=w5) -> (first subarray=w6, second subarray=w7)
      # Guard bits are prepended
      # to Sync and message bits.
      Build Array[ConcatenateInputs=True](w6, $"Sync Bits [#16]", $"Input bit stream", w7) -> w1
      w2 = $"error in"
    }
  }
  $"Output bit stream" <- w1
  $"error out" <- w2
