vi "Convolutional Coder.gvi"   [LabVIEW Communications System Design Software 2.0.1]
inputs:
  "Input bitstream": i8[]
  "Rate (k/n)": enum{"1/2", "none"} = "1/2"
  "Error in": error
outputs:
  "Coded bit stream": i8[]
  "Error out": error
diagram:
  # 1
  # 2
  # 3
  # 1. Selecting the proper coder, based on the status of the enum "Rate (k/n)".
  # 2. Adding as many 0 bits to the end of the stream as the constraint length is of the specific coder. It is needed to prevent loosing data on the decoder side.
  # 3. Generating the coded bitstream.
  case ($"Error in") {
    frame Error {
      w1 = $"Error in"
      w2 = $"Input bitstream"
    }
    frame No Error {
      case ($"Rate (k/n)") {
        frame "1/2" {
          Array Size(array=$"Input bitstream") -> (size(s)=w3)
          Initialize Array(element=0, size=7) -> w4
          Insert Into Array(inArray=$"Input bitstream", index0=w3, new=w4) -> w5
          for {
            w6 = each element of w5
            Feedback Node(initial value=0, input=w7) -> w8
            Feedback Node(initial value=0, input=w6) -> w9
            Feedback Node(initial value=0, input=w9) -> w10
            Feedback Node(initial value=0, input=w10) -> w7
            Feedback Node(initial value=0, input=w11) -> w12
            Logical Exclusive Or(w12, w7, w10, w9, w6) -> w13
            Feedback Node(initial value=0, input=w8) -> w11
            Logical Exclusive Or(w12, w11, w7, w10, w6) -> w14
            Build Array(w14, w13) -> w15
            concatenate w15 onto w2
          }
          w1 = $"Error in"
        }
        frame "none", Default {
          w1 = $"Error in"
          w2 = $"Input bitstream"
        }
      }
    }
  }
  $"Coded bit stream" <- w2
  $"Error out" <- w1
