vi "AWGN generation.gvi"   [LabVIEW Communications System Design Software 2.0.1]
inputs:
  "Waveform in": cluster{"t0": f64, "dt": f64, "Y": c128[]} = {"t0"=0, "dt"=1, "Y"=[]}
  "symbol rate": f64 = 10000
  "eb/n0 [dB of complex]": f64 = 10
  "Error In": error
outputs:
  "Error Out": error
  "Waveform out": cluster{"t0": f64, "dt": f64, "Y": c128[]}
uses:
  NI::Analysis::Generation::Gaussian White Noise.gvi
diagram:
  case ($"Error In") {
    frame Error {
      w1 = $"Waveform in"
      w2 = $"Error In"
    }
    frame No Error {
      Property Node(instance in=$"Waveform in") -> ("Y"=w3, "dt"=w4, instance out=w5)
      Array Size(array=w3) -> (size(s)=w6)
      # Calculate E
      for {
        w7 = each element of w3
        Absolute Value(x=w7) -> w9
        Square(x=w9) -> w10
        append w10 to w8
      }
      Add Array Elements(numeric array=w8) -> (sum=w11)
      # E = power of signal
      # w12: E
      Divide(x=w11, y=w6) -> w12
      # dB to lin
      Divide(x=$"eb/n0 [dB of complex]", y=10) -> w13
      Power Of 10(x=w13) -> w14
      w15 = 2  # M(PSK)
      Logarithm Base 2(x=w15) -> w16
      Multiply(w14, w16) -> w17
      # Es/N0 = Eb/Na*log_{2}M
      # Es/N0 = (C/N)*(B/fs)
      #
      # Es/N0 = energy per symbol
      # C/N = Carrier of Signal to noise ratio
      # B = Channel BW
      # Fs = Symbol per second
      Reciprocal(x=w4) -> w18
      Divide(x=w17, y=w18) -> w19
      Multiply($"symbol rate", w19) -> w20
      # multiply by to as WFM is complex
      Multiply(w20, 2) -> w21
      Divide(x=w12, y=w21) -> w22
      # w23: Noise  dev
      Square Root(x=w22) -> w23
      call "Gaussian White Noise.gvi"(samples=w6, standard deviation=w23) -> (Gaussian white noise=w24)
      # Generate AWGN noise using calculated Noise Deviation
      call "Gaussian White Noise.gvi"(samples=w6, standard deviation=w23) -> (Gaussian white noise=w25)
      Real And Imaginary To Complex(x=w24, y=w25) -> w26
      # Add noise to signal
      Add(w3, w26) -> w27
      Property Node(instance in=w5, "Y"=w27) -> (instance out=w1)
      w2 = $"Error In"
    }
  }
  $"Waveform out" <- w1
  $"Error Out" <- w2
