vi "Demodulation (PSK).gvi"   [LabVIEW Communications System Design Suite 2.0.1]
inputs:
  "Sync bits": u16
  "Waveform in": cluster{"t0": f64, "dt": f64, "Y": c128[]} = {"t0"=0, "dt"=1, "Y"=[]}
  "error in": error
  "Demodulation parameters": "Demodulation parameters.gtype"
outputs:
  "Messages out": i8[][]
  "error out": error
  "Sync found": bool
  "output complex waveform": cluster{"t0": f64, "dt": f64, "Y": c128[]}
types:
  T1 = cluster{"samples per symbol (16)": i32, "symbol map": c128[], "differential PSK": enum{"disable", "enable"}, "PSK type": enum{"normal", "shifted", "offset"}}
  "Burst Parameters.gtype" = cluster{"# Message Symbols": i32, "# Guard Symbols": i32, "Sync Bits": u16}
  "Coding and CRC.gtype" = cluster{"Rate (k/n)": enum{"1/2", "2/3"}, "CRC seed": u16}
  "Demodulation parameters.gtype" = cluster{"PSK system parameters": T1, "pulse shaping filter coefficients": f64[], "matched filter coefficients": f64[], "Burst Parameters": "Burst Parameters.gtype", "Coding and CRC": "Coding and CRC.gtype"}
diagram:
  # 1. Matched Filtering
  # 2. Finding the middle of a symbol  (as it was oversampled) using gardner algorithm.
  # 3. Decimate oversampled data using error array of gardner.
  # 4. turn BPSK symbols to 0 and 1. (decision making)
  # 5. Find sync sequence. If found cut down the message bits from burst (guard and sinc bits)
  # 6. Calculating the lenght of the message symbols. (add CRC; + additional bits from coding; multibly because of the code rate.)
  case ($"error in") {
    frame Error {
      w1 = $"error in"
      w2 = default
      w3 = $"Waveform in"
      w4 = default
    }
    frame No Error {
      # 1
      call "Matched Filtering.gvi"(Modulated waveform in=$"Waveform in", Error in=$"error in", Demodulation parameters=$"Demodulation parameters") -> (Filtered waveform out=w3, Filtered bits out=w5, Error out=w6)
      # 2
      call "Gardner.gvi"(Bits in=w5, Demodulation parameters=$"Demodulation parameters", Error In=w6) -> (Error array=w7, Error Out=w8, Bits out=w9)
      # 3
      call "Dacimating.gvi"(Error arary in=w7, Bits in=w9, Demodulation parameters=$"Demodulation parameters", Error In=w8) -> (Decimated bits out=w10, Error Out=w11)
      # 4
      call "Decision.gvi"(Bits in=w10, Error In=w11) -> (Demodulated bits=w12, Error Out=w13)
      # $"Sync bits": Sync bits
      Property Node(instance in=$"Demodulation parameters") -> ("Burst Parameters:# Message Symbols"=w14, "Coding and CRC:Rate (k/n)"=w15)
      # w15: Coding Rate
      # 6
      case (w15) {
        frame "1/2", Default {
          w16 = 2
          w17 = 7
        }
        frame "2/3" {
          Divide(x=3, y=2) -> w16
          w17 = 4
        }
      }
      # w14: #Message symbols
      Add(w14, 16) -> w18
      Add(w18, w17) -> w19
      To Double Precision Float(number=w19) -> w20
      Multiply(w20, w16) -> w21
      To Long Integer(number=w21) -> w22
      # 5
      call "Sync search.gvi"(Bits in=w12, Sync bits=$"Sync bits", Burst Parameters:# Message Symbols=w22, Error In=w13) -> (Sync found=w2, Messages out=w4, Error Out=w1)
    }
  }
  $"output complex waveform" <- w3
  $"Messages out" <- w4
  $"Sync found" <- w2
  $"error out" <- w1
