vi "Matched Filtering.gvi"   [LabVIEW Communications System Design Suite 2.0.1]
inputs:
  "Modulated waveform in": cluster{"t0": f64, "dt": f64, "Y": c128[]}
  "Error in": error
  "Demodulation parameters": "Demodulation parameters.gtype"
outputs:
  "Filtered waveform out": cluster{"t0": f64, "dt": f64, "Y": c128[]}
  "Filtered bits out": c128[]
  "Error out": error
types:
  T1 = cluster{"samples per symbol (16)": i32, "symbol map": c128[], "differential PSK": enum{"disable", "enable"}, "PSK type": enum{"normal", "shifted", "offset"}}
  "Burst Parameters.gtype" = cluster{"# Message Symbols": i32, "# Guard Symbols": i32, "Sync Bits": u16}
  "Coding and CRC.gtype" = cluster{"Rate (k/n)": enum{"1/2", "2/3"}, "CRC seed": u16}
  "Demodulation parameters.gtype" = cluster{"PSK system parameters": T1, "pulse shaping filter coefficients": f64[], "matched filter coefficients": f64[], "Burst Parameters": "Burst Parameters.gtype", "Coding and CRC": "Coding and CRC.gtype"}
diagram:
  # ---------------------------------1----------------------------------
  # 2
  # 3
  # 1. If no filter used, the array doesn't contain evrything. In this case we assuem that 1 bit is the length of the array
  # 2. Adding elements to the end of the array that will be cut down by the filter. I have added more, because the rest will be cut down after sync found
  # 		# of 0+j bits = 2*samples per symbol*(filter length+1)
  # 3. Matched filtering.
  case ($"Error in") {
    frame Error {
      w1 = $"Error in"
      w2 = $"Modulated waveform in"
      w3 = c128[] []
    }
    frame No Error {
      # w4: Samples ber symbol
      Property Node(instance in=$"Demodulation parameters") -> ("matched filter coefficients"=w5, "PSK system parameters:samples per symbol (16)"=w4)
      Property Node(instance in=$"Modulated waveform in") -> ("Y"=w6, instance out=w7)
      Array Size(array=w6) -> (size(s)=w8)
      # w5: Matched Filter Coefficients
      Array Size(array=w5) -> (size(s)=w9)
      Decrement(x=w9) -> w10
      Is Less Or Equal To 0(x=w10) -> w11
      Select(s=w11, t=1, f=w10) -> w12
      Multiply(2, w12) -> w13
      Multiply(w13, w4) -> w14
      Initialize Array(element=1+1i, size=w14) -> w15
      Insert Into Array(inArray=w6, index0=w8, new=w15) -> w16
      Property Node(instance in=w7, "Y"=w16) -> (instance out=w17)
      # Matched filtering
      call "MT Apply Matched Filter (Generic).gvi"(input complex waveform=w17, matched filter coefficients=w5, samples per symbol=w4, error in=$"Error in") -> (output complex waveform=w18, error out=w1)
      Property Node(instance in=w18) -> ("Y"=w19, instance out=w20)
      Delete From Array(inArray=w19, length (1)=w8, index0=0) -> (deleted=w3)
      Property Node(instance in=w20, "Y"=w3) -> (instance out=w2)
    }
  }
  $"Filtered waveform out" <- w2
  $"Filtered bits out" <- w3
  $"Error out" <- w1
