vi "Modulation (PSK).gvi"   [LabVIEW Communications System Design Software 2.0.1]
inputs:
  "input bit stream": i8[]
  "Modulation parameters": "Modulation parameters.gtype"
  "symbol rate": f64 = 1
  "error in": error
outputs:
  "error out": error
  "output complex waveform": cluster{"t0": f64, "dt": f64, "Y": c128[]}
  "Modulated bits": c128[]
types:
  T1 = cluster{"samples per symbol": i32, "M-PSK": i32, "differential PSK": enum{"disable", "enable"}, "PSK type": enum{"normal", "shifted", "offset"}}
  "Burst Parameters.gtype" = cluster{"# Message Symbols": i32, "# Guard Symbols": i32, "Sync Bits": u16}
  "Coding and CRC.gtype" = cluster{"Rate (k/n)": enum{"1/2", "none"}, "CRC seed": u16}
  "Modulation parameters.gtype" = cluster{"PSK Parameters": T1, "pulse shaping filter coefficients": f64[], "Burst Parameters": "Burst Parameters.gtype", "Coding and CRC": "Coding and CRC.gtype"}
diagram:
  Property Node(instance in=$"Modulation parameters") -> ("PSK Parameters:samples per symbol"=w1, "pulse shaping filter coefficients"=w2)
  # 1
  # 2
  # 3
  # 3. Desired filter applied. It also generates more bits per symbol, so samples per symbol can be achieved.
  case ($"error in") {
    frame Error {
      w3 = $"error in"
      w4 = default
      w5 = default
    }
    frame No Error {
      call "Differencial logic.gvi"(Burst bits in=$"input bit stream", Error In=$"error in") -> (Bits out=w6, Error Out=w7)
      call "Zero insertion.gvi"(Bits in=w6, Samples per symbols=w1, Error In=w7) -> (Bits out=w8, Error Out=w9)
      call "Pulse Shaping Filter.gvi"(Bits in=w8, Filter Coefficients=w2, Symbol Rate [Hz]=$"symbol rate", Error in=w9, Samples per Symbol=w1) -> (Modulated bits out=w5, Modulated waveform out=w4, Error out=w3)
    }
  }
  $"Modulated bits" <- w5
  $"output complex waveform" <- w4
  $"error out" <- w3
