vi "Modulation test.gvi"   [LabVIEW Communications System Design Suite 2.0.1]
panel controls:
  "symbol rate": f64 = 10000
  "PSK Parameters": T2 = {"samples per symbol"=16, "M-PSK"=2, "differential PSK"="enable", "PSK type"="normal"}
  "Tab": i32
  "Burst Parameters": "Burst Parameters.gtype" = {"# Message Symbols"=1000, "# Guard Symbols"=80, "Sync Bits"=61440}
  "Cluster Constant": "Filter.gtype" = {"Pulse shaping filter"="Raised Cosine", "Pulse filter parameter"=0.5, "Matched filter"="Root Raised Cos", "Matched filter parameter"=0.5}
  "Coding and CRC": "Coding and CRC.gtype" = {"Rate (k/n)"="1/2", "CRC seed"=4080}
panel indicators:
  "Constellation": T1[]
  "Modulation": waveform<f64>
  "Demodulation": f64[][]
  "Sync found": bool
  "CRC": u16
types:
  T1 = cluster{"constellation": f64[], "oversampled data": f64[]}
  T2 = cluster{"samples per symbol": i32, "M-PSK": i32, "differential PSK": enum{"disable", "enable"}, "PSK type": enum{"normal", "shifted", "offset"}}
  "Burst Parameters.gtype" = cluster{"# Message Symbols": i32, "# Guard Symbols": i32, "Sync Bits": u16}
  T3 = enum{"none", "Raised Cosine", "Root Raised Cos", "Gaussian"}
  "Filter.gtype" = cluster{"Pulse shaping filter": T3, "Pulse filter parameter": f64, "Matched filter": T3, "Matched filter parameter": f64}
  "Coding and CRC.gtype" = cluster{"Rate (k/n)": enum{"1/2", "2/3"}, "CRC seed": u16}
diagram:
  Property Node(instance in=$"Coding and CRC") -> ("Rate (k/n)"=w1)
  call "Modulation init.gvi"(PSK Parameters=$"PSK Parameters", Filter=$"Cluster Constant", Burst Parameters=$"Burst Parameters", Coding and CRC=$"Coding and CRC") -> (Demodulation parameters=w2, Modulation parameters=w3, error out=w4)
  # ----------------------------------TRANSMITTER-----------------------------------------
  Property Node(instance in=$"Burst Parameters") -> ("# Message Symbols"=w5, "# Guard Symbols"=w6, "Sync Bits"=w7)
  Property Node(instance in=$"PSK Parameters") -> ("M-PSK"=w8)
  call "Message bit generation.gvi"(# Message Symbols=w5, error in=w4, M-PSK=w8) -> (Output Bit Stream=w9, error out=w10)
  Array Size(array=w9) -> (size(s)=w11)
  # --------INITIALIZATION------
  call "CRC.gvi"(Message In=w9, Error In=w10, Forward?=TRUE, # of MSG bits=w11) -> (Data out=w12, Error Out=w13)
  call "Convolutional Coder.gvi"(Input bitstream=w12, Rate (k/n)=w1, Error in=w13) -> (Coded bit stream=w14, Error out=w15)
  Number To Boolean Array(number=w7) -> (Boolean array=w16)
  Boolean To Integer(Boolean=w16) -> (0, 1=w17)
  To Byte Integer(number=w17) -> w18
  call "Burst Building.gvi"(Sync Bits [#16]=w18, Input bit stream=w14, error in=w15, M-PSK=2, # Guard Symbols=w6) -> (Output bit stream=w19, error out=w20)
  call "Modulation (PSK).gvi"(input bit stream=w19, Modulation parameters=w3, symbol rate=$"symbol rate", error in=w20) -> (error out=w21, output complex waveform=w22)
  for (N = 1) {
    call "Demodulation (PSK).gvi"(Sync bits=w7, Waveform in=w22, error in=w21, Demodulation parameters=w2) -> (Messages out=w23, error out=w24, Sync found=w25, output complex waveform=w26)
    # -------------------------------------RECIEVER------------------------------------
    s1 = w24  # shift register
    for {
      w27 = each element of w23
      call "MT Format Constellation.gvi"(waveform=w26) -> (constellation graph=w28)
      $Constellation <- w28
      Property Node(instance in=w26) -> ("Y"=w29, "dt"=w30)
      Complex To Real Imaginary(x + iy=w29) -> (y=w31)
      Build Waveform Node(Y=w31, dt=w30) -> (output waveform=w32)
      $Modulation <- w32
      $"Sync found" <- w25
      To Double Precision Float(number=w9) -> w33
      call "Convolutional Decoder.gvi"(Coding rate=w1, Coded bit stream=w27, Error in=s1) -> (Decoded bits=w34, Error Out=w35)
      call "CRC.gvi"(Message In=w34, Error In=w35, Forward?=FALSE, # of MSG bits=w11) -> (Data out=w36, CRC value=w37, Error Out=w38)
      To Double Precision Float(number=w36) -> w39
      Build Array(w33, w39) -> w40
      $Demodulation <- w40
      Add Array Elements(numeric array=w37) -> (sum=w41)
      $CRC <- w41
      next s1 = w38
    }
    call "Display Error.gvi"(error in=s1)
  }
