vi "Pulse Shaping Filter.gvi"   [LabVIEW Communications System Design Suite 2.0.1]
inputs:
  "Bits in": c128[]
  "Filter Coefficients": f64[]
  "Symbol Rate [Hz]": f64
  "Error in": error
  "Samples per Symbol": i32
outputs:
  "Modulated bits out": c128[]
  "Modulated waveform out": cluster{"t0": f64, "dt": f64, "Y": c128[]}
  "Error out": error
types:
  "filter structure.gtype" = u32
  "filter.gtype" = cluster{"filter structure": "filter structure.gtype", "forward coefficients": f64[], "reverse coefficients": f64[], "sampling frequency": f64}
uses:
  NI::Analysis::Filtering::Filtering (CDB).gvi
diagram:
  case ($"Error in") {
    frame Error {
      w1 = $"Bits in"
      w2 = default
      w3 = $"Error in"
    }
    frame No Error {
      w4 = cluster{"t0": f64, "dt": f64, "Y": c128[]} {all zero or empty}
      Array Size(array=$"Filter Coefficients") -> (size(s)=w5)
      Multiply(w5, 1) -> w6
      w7 = "filter.gtype" {"filter structure"=3, "forward coefficients"=[], "reverse coefficients"=[], "sampling frequency"=0}
      Property Node(instance in=w7, "forward coefficients"=$"Filter Coefficients") -> (instance out=w8)
      Initialize Array(element=0.05+0i, size=w6) -> w9
      Build Array[ConcatenateInputs=True](w9, $"Bits in") -> w10
      call "Filtering (CDB).gvi"(signal=w10, filter=w8, error in=$"Error in") -> (filtered signal=w11, error out=w3)
      Delete From Array(inArray=w11, length (1)=w6, index0=0) -> w1
      Multiply($"Samples per Symbol", $"Symbol Rate [Hz]") -> w12
      Reciprocal(x=w12) -> w13
      Property Node(instance in=w4, "dt"=w13, "Y"=w1) -> (instance out=w2)
    }
  }
  $"Modulated bits out" <- w1
  $"Modulated waveform out" <- w2
  $"Error out" <- w3
